# Dynamo graph Add object grids.dyn (Dynamo 2.17.0.3472)
# author: Bruno Muniz
# Adiciona objetos à intersecção dos grids selecionados.

# group: Inputs
# note: O objeto será posicionado tendo em função seu ponto de inserção na intersecção dos grids selecionados.
n01_selecione_a_família_do_objeto = FamilyTypes("UC-Universal Columns-Column:UC305x305x97")  # "01 | Selecione a família do objeto a ser adicionado:"; graph input
selecione_os_grids = DSModelElementsByCategorySelection("OST_Grids")  # 4 picked in the model; graph input
n012_selecione_o_nível_do_objeto = Levels("Level 0")  # "012| Selecione o nível do objeto a ser adicionado:"; graph input

curve = Grid.Curve(grid=selecione_os_grids)
intersect = Geometry.Intersect(geometry=curve, other=curve, lacing=CrossProduct)
uniqueItems = List.UniqueItems(list=intersect@L1)
origin = Point.Origin()
type = Object.Type(object=origin)
removeIfNot = List.RemoveIfNot(list=uniqueItems@L2, type=type)
code_block = CodeBlock { 0; }
getItemAtIndex = List.GetItemAtIndex(list=removeIfNot@L1, index=code_block)
watch = Watch(getItemAtIndex)
pruneDuplicates = Point.PruneDuplicates(points=watch)
byPointAndLevel = FamilyInstance.ByPointAndLevel(familyType=n01_selecione_a_família_do_objeto, point=pruneDuplicates, level=n012_selecione_o_nível_do_objeto)

# group: Output
watch_2 = Watch(byPointAndLevel)  # graph output
