# Dynamo graph Add parameter.dyn (Dynamo 2.17.0.3472)
# author: Bruno Muniz
# Cria e adiciona um parâmetro à família de um objeto selecionado.

# group: Inputs
n02_defina_o_nome_do_parâmetro = StringInput("Param2")  # "02 | Defina o nome do parâmetro"; graph input
n03_defina_o_tipo_do_parâmetro = SpecTypes("autodesk.spec:spec.string")  # "03 | Defina o tipo do parâmetro"; graph input
n04_defina_o_grupo_do_parâmetro = GroupTypes("autodesk.parameter.group:ifc")  # "04 | Defina o grupo do parâmetro"; graph input
# note: Parâmetros de instância são específicos do objeto selecionado, já os parâmetros de tipo são comuns a todos os objetos da família.
n05_o_parâmetro_é_de_instância = BoolSelector(true)  # "05 | O parâmetro é de instância?"; graph input
# note: O parâmetro criado será associado à família do objeto.
n01_escolha_o_objeto = DSModelElementSelection()  # "01 | Escolha o objeto"; 1 picked in the model; graph input

nome_do_grupo_do_parâmetro = StringInput("Params")
getCategory = Element.GetCategory(element=n01_escolha_o_objeto)
list_create = List.Create(item0=getCategory)
createProjectParameter = Parameter.CreateProjectParameter(parameterName=n02_defina_o_nome_do_parâmetro, groupName=nome_do_grupo_do_parâmetro, specType=n03_defina_o_tipo_do_parâmetro, groupType=n04_defina_o_grupo_do_parâmetro, instance=n05_o_parâmetro_é_de_instância, categoryList=list_create)
